# Grasshopper definition 1107 basic sim.gh (Grasshopper 1.0.7)
# plug-ins: Bifocals, Kangaroo2 Components, Pufferfish

_1112_fp = Curve([<curve referenced from the Rhino model> x859])  # disabled
made_2d = Curve([<curve referenced from the Rhino model> x992])  # disabled
# Manual
# 
# 1. go to ani view (plan)
# 2. move center of curve to the center of the plane (dont need to angle, just move can alr)
# 3. set curve in GH and run the animation
# 4. bake points to count
_1107_fp = Curve([<curve referenced from the Rhino model> x839])  # disabled
clscrv = CloseCurve(Curve=_1112_fp, CloseType=0, Bulge=0.5, Tolerance=0)  # -> Closed, R; disabled

panel = Panel("!. Gerenate points")  # disabled
number_slider = Slider(100, range=0..100)  # disabled
surface = Surface(<surface referenced from the Rhino model>)  # disabled
divide_surface = DivideSurface(Surface=surface, UCount=number_slider, VCount=number_slider)  # -> Points, Normals, Parameters; disabled
unit_z = UnitZ(Factor=-5)  # disabled
raindrop_points = Point(divide_surface.Points)  # disabled
move = Move(Geometry=raindrop_points, Motion=unit_z)  # -> Geometry, Transform; disabled

unit_z_2 = UnitZ(Factor=-10)  # disabled
panel_2 = Panel("to be changed")
pt = Point([<point referenced from the Rhino model> x5000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])
pt_2 = Point(move.Geometry)  # disabled
unit_z_3 = UnitZ(Factor=1)  # disabled
mesh_changed = Mesh(<mesh referenced from the Rhino model>)
original_mesh = Mesh(<mesh referenced from the Rhino model>)

# ----
# 1. Project points onto Combined Mesh
Z = UnitZ(Factor=-5)
move_2 = Move(Geometry=pt, Motion=Z)  # -> Geometry, Transform
Z_2 = UnitZ(Factor=1)
project = ProjectPoint(Point=move_2.Geometry, Direction=Z_2, Geometry=flatten(original_mesh))  # -> Point, Index
# at animate: 100, lost of recorded data (lines)
# 
# increase FV to increase gravity. faster pull
clean = CleanTree(RemoveNulls=True, RemoveInvalid=True, RemoveEmpty=True, Tree=project.Point)

number_slider_2 = Slider(1.5, range=0..10)
panel_3 = Panel("2. Kangaroo Step Solver")
Z_3 = UnitZ(Factor=-3)
sc = SphereCollide(Points=clean, Radius=number_slider_2, Strength=1)
onmesh = OnMesh(Points=clean, Mesh=original_mesh, Strength=0.8)
load = Load(Point=clean, ForceVector=Z_3)
number_slider_3 = Slider(5, range=0..5)
stepsolver = StepSolver(
    GoalObjects=[onmesh, load, sc],
    Tolerance=0.01,
    Momentum=False,
    Damping=0.99,
    SubIterations=number_slider_3,
    Animate=Slider(10, range=0..10))  # -> I, V, O

# ---- group: Rain-Runoff Inundation Toggle
rec = DataRecorder(stepsolver.V, DataLimit=-10, RecordData=True)

# ----
lng = ListLength(List=clean)
division = Division(A=stepsolver.I, B=number_slider_3)
series = Series(Start=lng, Step=0, Count=division)
partition = PartitionList(List=rec, Size=series)
cloud = CloudDisplay(Points=stepsolver.V, Colours=ColourSwatch(SwatchColor=RGB(58, 126, 186)), Size=number_slider_2, SpriteType=1)
flip = FlipMatrix(Data=partition)
rev = ReverseList(List=flip)
Z_4 = UnitZ(Factor=Slider(0.1, range=0..10))
item = ListItem(List=rev, Index=0, Wrap=True)  # -> Item, Item1
move_3 = Move(Geometry=stepsolver.V, Motion=Z_4)  # -> Geometry, Transform
ln = Line(StartPoint=item.Item, EndPoint=item.Item1)
len = Length(Curve=ln)
cull = CullPattern(List=ln, CullPattern=len)
move_4 = Move(Geometry=cull, Motion=Z_4)  # -> Geometry, Transform
rec_2 = DataRecorder(move_4.Geometry, DataLimit=-10, RecordData=True)

panel_4 = Panel("Create Mesh")  # disabled
number_slider_4 = Slider(39, range=0..100)  # disabled
boundary_surfaces = BoundarySurfaces(Edges=made_2d)  # disabled
unit_z_4 = UnitZ(Factor=number_slider_4)  # disabled

move_5 = Move(Geometry=boundary_surfaces, Motion=unit_z_2)  # -> Geometry, Transform; disabled

extrude = Extrude(Base=move_5.Geometry, Direction=unit_z_4)  # disabled
trim_solid = TrimSolid(Shape=surface, Cutters=extrude)  # disabled

mesh = Mesh(trim_solid)  # disabled
project_point = ProjectPoint(Point=move.Geometry, Direction=unit_z_3, Geometry=flatten(mesh))  # -> Point, Index; disabled
clean_tree = CleanTree(RemoveNulls=True, RemoveInvalid=True, RemoveEmpty=False, Tree=project_point.Point)  # disabled
