# Grasshopper definition generate new topo + new points.gh (Grasshopper 1.0.7)
# plug-ins: Bifocals, Pufferfish

# ----
# 1. Creating the base terrain map
# ****
# contour lines has to be larger than the bounding box area, and also below it, so that the points canbe projected upwards
# ****
# bounding box cannot be too complex, U & V will have problems, try with a simple shape bounding box and then do a bake and split.
# turns bounding box into a surface
# project points onto the terrain mesh surface
# high no. of points for high res results
# need to add 1 as need to acc for start point
# A = points of U, B = 1
bounding_box = Curve(<curve referenced from the Rhino model>)  # disabled
number_slider = Slider(100, range=0..1000)  # disabled
number_slider_2 = Slider(100, range=0..1000)  # disabled
contour_lines = Curve([<curve referenced from the Rhino model> x96])  # disabled
boundary = BoundarySurfaces(Edges=bounding_box)  # disabled
explode = Explode(Curve=contour_lines, Recursive=True)  # -> Segments, flatten(Vertices); disabled
sdivide = DivideSurface(Surface=boundary, UCount=number_slider, VCount=number_slider_2)  # -> Points, Normals, Parameters; disabled
del = DelaunayMesh(Points=explode.Vertices, Plane=PlaneXY(0, 0, 0))  # disabled
Z = UnitZ(Factor=1)  # disabled
addition = Addition(A=number_slider, B=1)  # disabled
# ****
# about importing from QGIS to RHINO
# ****
# into DXF file
# 
# or as a SHP in grasshopper >> less ideal as there is no layer created in rhino
meshray = MeshRay(Mesh=del, Point=sdivide.Points, Direction=Z)  # -> flatten(Point), Hit; disabled
srfgrid = SurfaceFromPoints(Points=flatten(meshray.Point), UCount=addition, Interpolate=False)  # disabled

srf = Surface(srfgrid)  # disabled
topography_surface = Surface(<surface referenced from the Rhino model>)  # disabled

panel = Panel("1. generate points (raindrops)")
brec = BoundingRectangle(Geometry=topography_surface, Plane=PlaneXY(0, 0, 0), Axis=0, Slide=0, Union=True)  # -> Bounding, DimensionX, DimensionY; disabled
number_slider_3 = Slider(80, range=0..100)  # disabled
number_slider_4 = Slider(80, range=0..100)  # disabled
srf_2 = Surface(brec.Bounding)  # disabled
divide = DivideDomain²(Domain=srf_2, UCount=number_slider_4, VCount=number_slider_3)  # disabled
subsrf = Isotrim(Surface=srf_2, Domain=divide)  # disabled
project = Project(Curve=subsrf, Brep=topography_surface, Direction=Vector(0, 0, 1))  # disabled
rec = Rectangle(project)  # disabled
area = Area(Geometry=rec)  # -> Area, Centroid; disabled

pt = Point(area.Centroid)  # disabled
